# Grasshopper definition display.gh (Grasshopper 1.0.7)
# plug-ins: LunchBox, GH_CPython

integer = Integer(Slider(2, range=0..10))
file_path = FilePath("E:\project\AI_Designer\PARL_01\examples\MADDPG_16_hyper_vision\savegoodresults\episode_data.csv")
ghpython_script = GhPythonScript(filepath=file_path, row_index=integer)  # -> Episode, MapSize, BoundaryVertices, StartPoint, EndPoint, Trees, Structures, Landscapes, Elevation, Trajectories
# ---------- ghpython_script: Python ----------
import csv, os

def parse_points(s):
    """
    将字符串 s (格式 "x1,y1;x2,y2;...") 转换为一个二维列表 [[x1, y1], [x2, y2], ...]
    """
    pts = []
    if s is None or s.strip() == "":
        return pts
    pairs = s.split(";")
    for pair in pairs:
        pair = pair.strip()
        if pair == "":
            continue
        coords = pair.split(",")
        if len(coords) >= 2:
            try:
                x = float(coords[0])
                y = float(coords[1])
                pts.append([x, y])
            except:
                pass
    return pts

def parse_matrix(s):
    """
    将字符串 s (格式 "v11,v12,...|v21,v22,...|...") 转换为二维列表，每一行为一列表
    """
    matrix = []
    if s is None or s.strip() == "":
        return matrix
    rows = s.split("|")
    for r in rows:
        r = r.strip()
        if r == "":
            continue
        vals = r.split(",")
        try:
            row = [float(v) for v in vals if v.strip() != ""]
            matrix.append(row)
        except:
            pass
    return matrix

# ---------------------- 输入处理 ----------------------
# 假设在 GhPython 中已经设置了两个输入：filepath (字符串) 和 row_index (整数)
# 例如：filepath = "C:/.../episode_data.csv" ; row_index = 0  表示读取第一行数据

# 初始化输出变量（默认值）
Episode = ""
MapSize = ""
BoundaryVertices = []  # 列表，每个元素为 [x, y]
StartPoint = []        # 单个 [x, y]
EndPoint = []          # 单个 [x, y]
Trees = []             # 列表
Structures = []        # 列表
Landscapes = []        # 列表
Elevation = []         # 二维列表
Trajectories = {}      # 字典，键为例如 "agent_0_trajectory"

# 判断文件是否存在
if filepath and os.path.exists(filepath):
    with open(filepath, "r") as f:
        reader = list(csv.DictReader(f))
        if row_index < 0 or row_index >= len(reader):
            print("Row index out of range.")
        else:
            row = reader[row_index]
            # 解析各字段（字段名称须与保存 CSV 时一致）
            Episode = row.get("episode", "")
            MapSize = row.get("map_size", "")
            BoundaryVertices = parse_points(row.get("boundary_vertices", ""))
            # 对于起点和终点，CSV保存的是 "x,y" 格式，解析后只取第一个点
            sp_str = row.get("start_point", "")
            if sp_str != "":
                pts = parse_points(sp_str)
                if pts:
                    StartPoint = pts[0]
            ep_str = row.get("end_point", "")
            if ep_str != "":
                pts = parse_points(ep_str)
                if pts:
                    EndPoint = pts[0]
            Trees = parse_points(row.get("trees", ""))
            Structures = parse_points(row.get("structures", ""))
            Landscapes = parse_points(row.get("landscapes", ""))
            Elevation = parse_matrix(row.get("elevation", ""))
            # 对于各智能体轨迹，遍历所有字段名中以 "_trajectory" 结尾的
            for key in row.keys():
                if key.endswith("_trajectory"):
                    traj_str = row.get(key, "")
                    traj = parse_points(traj_str)
                    Trajectories[key] = traj
else:
    print("Filepath not provided or file does not exist.")

# ---------------------- 输出变量赋值 ----------------------
# 在 GhPython 中，组件的输出变量名称需与下列变量名相同：
# Episode, MapSize, BoundaryVertices, StartPoint, EndPoint, Trees, Structures, Landscapes, Elevation, Trajectories
print(Trees)
print(type(Trees))
print(Structures)
print(type(Structures))
# ---------- end ghpython_script ----------
read_csv = ReadCSV(CSVString=file_path, Delimiter=",")  # -> Headers, Values
panel = Panel(ghpython_script.Trees)
panel_2 = Panel(ghpython_script.Episode)
panel_3 = Panel(ghpython_script.MapSize)
ghpython_script_2 = GhPythonScript()  # -> out, a; inputs BoundaryVertices: list, StartPoint: list, EndPoint: list, Trees: list
# ---------- ghpython_script_2: Python ----------
import rhinoscriptsyntax as rs

# --- 1. 边界 --- 
# 将 BoundaryVertices（列表，每个元素 [x, y]）转换为 Rhino 的 polyline 曲线（闭合曲线）
if BoundaryVertices and len(BoundaryVertices) > 1:
    # 将二维坐标扩展为三维（z=0）
    boundary_pts = [(pt[0], pt[1], 0) for pt in BoundaryVertices]
    # 如果首尾不相同，则闭合曲线：在末尾添加第一个点
    if boundary_pts[0] != boundary_pts[-1]:
        boundary_pts.append(boundary_pts[0])
    boundary_geo = rs.AddPolyline(boundary_pts)
else:
    boundary_geo = None

# --- 2. 起点与终点 ---
if StartPoint and len(StartPoint) >= 2:
    start_geo = rs.AddPoint((StartPoint[0], StartPoint[1], 0))
else:
    start_geo = None

if EndPoint and len(EndPoint) >= 2:
    end_geo = rs.AddPoint((EndPoint[0], EndPoint[1], 0))
else:
    end_geo = None

# --- 3. 兴趣点 ---
# 利用 rs.AddPoint 将各兴趣点转换为 Rhino 点对象
tree_geos = [rs.AddPoint((pt[0], pt[1], 0)) for pt in Trees] if Trees else []
structure_geos = [rs.AddPoint((pt[0], pt[1], 0)) for pt in Structures] if Structures else []
landscape_geos = [rs.AddPoint((pt[0], pt[1], 0)) for pt in Landscapes] if Landscapes else []

# --- 4. 智能体轨迹 ---
# 对于 Trajectories 字典中每个键值对，将每个轨迹（列表，每个元素 [x, y]）转换为 polyline 曲线
trajectory_geos = []
if Trajectories:
    for key, traj in Trajectories.items():
        if traj and len(traj) > 1:
            # 转换为三维点
            traj_pts = [(pt[0], pt[1], 0) for pt in traj]
            # 这里不一定需要闭合曲线，直接生成折线即可
            curve_id = rs.AddPolyline(traj_pts)
            trajectory_geos.append(curve_id)

# --- 输出 ---
# 请确保 GhPython 组件的输出参数名称分别为：
# boundary_geo, start_geo, end_geo, tree_geos, structure_geos, landscape_geos, trajectory_geos
# ---------- end ghpython_script_2 ----------

ghpython_script_3 = GhPythonScript(x=ghpython_script.Trees)  # -> flattened_x; inputs x: list
# ---------- ghpython_script_3: Python ----------
__author__ = "zihua"
__version__ = "2025.02.10"

import rhinoscriptsyntax as rs
print(x)
def flatten_list(nested_list):
    """
    将嵌套列表转换为一维列表。
    例如：[[1, 2], [3, 4], [5, 6]]  ->  [1, 2, 3, 4, 5, 6]
    """
    return [element for sublist in nested_list for element in sublist]


flattened_x = flatten_list(x)
print(x)
print(flattened_x)
# ---------- end ghpython_script_3 ----------
partition_list = PartitionList(List=ghpython_script_3, Size=2)
list_item = ListItem(List=partition_list, Index=0, Wrap=True)  # -> Item, Item1
panel_4 = Panel(ghpython_script_3)
construct_point = ConstructPoint(XCoordinate=list_item.Item, YCoordinate=list_item.Item1, ZCoordinate=0)  # -> flatten(Point)
polyline = PolyLine(Vertices=construct_point, Closed=True)

ghpython_script_4 = GhPythonScript(x=ghpython_script.BoundaryVertices)  # -> flattened_x; inputs x: list
# ---------- ghpython_script_4: Python ----------
__author__ = "zihua"
__version__ = "2025.02.10"

import rhinoscriptsyntax as rs

def flatten_list(nested_list):
    """
    将嵌套列表转换为一维列表。
    例如：[[1, 2], [3, 4], [5, 6]]  ->  [1, 2, 3, 4, 5, 6]
    """
    return [element for sublist in nested_list for element in sublist]


flattened_x = flatten_list(x)
print(flattened_x)
# ---------- end ghpython_script_4 ----------
partition_list_2 = PartitionList(List=ghpython_script_4, Size=2)
list_item_2 = ListItem(List=partition_list_2, Index=0, Wrap=True)  # -> Item, Item1
panel_5 = Panel(ghpython_script_4)
construct_point_2 = ConstructPoint(XCoordinate=list_item_2.Item, YCoordinate=list_item_2.Item1, ZCoordinate=0)  # -> flatten(Point)
polyline_2 = PolyLine(Vertices=construct_point_2, Closed=True)

list_item_3 = ListItem(List=ghpython_script.StartPoint, Index=0, Wrap=True)  # -> Item, Item1
construct_point_3 = ConstructPoint(XCoordinate=list_item_3.Item, YCoordinate=list_item_3.Item1, ZCoordinate=0)

list_item_4 = ListItem(List=ghpython_script.EndPoint, Index=0, Wrap=True)  # -> Item, Item1
construct_point_4 = ConstructPoint(XCoordinate=list_item_4.Item, YCoordinate=list_item_4.Item1, ZCoordinate=0)

gh_cpython = GH_CPython(x=ghpython_script.Trees)  # -> flattened_x; inputs x: list
#   port x: [required] - [type = int] - [default = None] Descripe your input here * bullet point. * bullet point
#   port flattened_x: indicate your output description here. refers to a new line.
# ---------- gh_cpython: Python ----------
__author__ = "zihua"
__version__ = "2025.02.10"


print(x)
def flatten_list(nested_list):
    """
    将嵌套列表转换为一维列表。
    例如：[[1, 2], [3, 4], [5, 6]]  ->  [1, 2, 3, 4, 5, 6]
    """
    return [element for sublist in nested_list for element in sublist]


flattened_x = flatten_list(x)
print(x)
print(flattened_x)
# ---------- end gh_cpython ----------
