# Grasshopper definition displayR8.gh (Grasshopper 1.0.8)
# plug-ins: RhinoCodePluginGH, Human, BubalusGH2.0

integer = Integer(Slider(1, range=0..10))
file_path = FilePath("E:\project\AI_Designer\PARL_01\examples\MADDPG_16_hyper_vision\savegoodresults\episode_data.csv")
python_3_script = Python3Script(filepath=file_path, row_index=integer)  # -> out, Episode, MapSize, BoundaryVertices, StartPoint, EndPoint, Trees, Structures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
# ---------- python_3_script: Python ----------
import csv, os

def parse_points(s):
    """
    将字符串 s (格式 "x1,y1;x2,y2;...") 转换为一个二维列表 [[x1, y1], [x2, y2], ...]
    """
    pts = []
    if s is None or s.strip() == "":
        return pts
    pairs = s.split(";")
    for pair in pairs:
        pair = pair.strip()
        if pair == "":
            continue
        coords = pair.split(",")
        if len(coords) >= 2:
            try:
                x = float(coords[0])
                y = float(coords[1])
                pts.append([x, y])
            except:
                pass
    return pts

def parse_matrix(s):
    """
    将字符串 s (格式 "v11,v12,...|v21,v22,...|...") 转换为二维列表，每一行为一列表
    """
    matrix = []
    if s is None or s.strip() == "":
        return matrix
    rows = s.split("|")
    for r in rows:
        r = r.strip()
        if r == "":
            continue
        vals = r.split(",")
        try:
            row = [float(v) for v in vals if v.strip() != ""]
            matrix.append(row)
        except:
            pass
    return matrix

# ---------------------- 输入处理 ----------------------
# 假设在 GhPython 中已经设置了两个输入：filepath (字符串) 和 row_index (整数)
# 例如：filepath = "C:/.../episode_data.csv" ; row_index = 0  表示读取第一行数据

# 初始化输出变量（默认值）
Episode = ""
MapSize = ""
BoundaryVertices = []  # 列表，每个元素为 [x, y]
StartPoint = []        # 单个 [x, y]
EndPoint = []          # 单个 [x, y]
Trees = []             # 列表
Structures = []        # 列表
Landscapes = []        # 列表
Elevation = []         # 二维列表
Trajectories = []      # 嵌套列表，按智能体的顺序存储路径

# 判断文件是否存在
if filepath and os.path.exists(filepath):
    with open(filepath, "r") as f:
        reader = list(csv.DictReader(f))
        if row_index < 0 or row_index >= len(reader):
            print("Row index out of range.")
        else:
            row = reader[row_index]
            # 解析各字段（字段名称须与保存 CSV 时一致）
            Episode = row.get("episode", "")
            MapSize = row.get("map_size", "")
            BoundaryVertices = parse_points(row.get("boundary_vertices", ""))
            # 对于起点和终点，CSV保存的是 "x,y" 格式，解析后只取第一个点
            sp_str = row.get("start_point", "")
            if sp_str != "":
                pts = parse_points(sp_str)
                if pts:
                    StartPoint = pts[0]
            ep_str = row.get("end_point", "")
            if ep_str != "":
                pts = parse_points(ep_str)
                if pts:
                    EndPoint = pts[0]
            Trees = parse_points(row.get("trees", ""))
            Structures = parse_points(row.get("structures", ""))
            Landscapes = parse_points(row.get("landscapes", ""))
            Elevation = parse_matrix(row.get("elevation", ""))
            
            # 对于各智能体轨迹，遍历所有字段名中以 "_trajectory" 结尾的
            for key in row.keys():
                if key.endswith("_trajectory"):
                    traj_str = row.get(key, "")
                    traj = parse_points(traj_str)
                    # 添加智能体的轨迹到 Trajectories 列表
                    Trajectories.append(traj)
else:
    print("Filepath not provided or file does not exist.")

# ---------------------- 输出变量赋值 ----------------------
# 在 GhPython 中，组件的输出变量名称需与下列变量名相同：
# Episode, MapSize, BoundaryVertices, StartPoint, EndPoint, Trees, Structures, Landscapes, Elevation, Trajectories
# ---------- end python_3_script ----------

construct_domain = ConstructDomain(DomainStart=0, DomainEnd=Slider(5, range=0..10))
deconstruct_domain = DeconstructDomain(Domain=construct_domain)  # -> Start, End
series = Series(Start=0, Step=1, Count=python_3_script.MapSize)
python_3_script_2 = Python3Script(x=python_3_script.Elevation)  # -> flattened_x; inputs x: list
# ---------- python_3_script_2: Python ----------
__author__ = "zihua"
__version__ = "2025.02.10"

import rhinoscriptsyntax as rs

def flatten_list(nested_list):
    """
    将嵌套列表转换为一维列表。
    例如：[[1, 2], [3, 4], [5, 6]]  ->  [1, 2, 3, 4, 5, 6]
    """
    return [element for sublist in nested_list for element in sublist]


flattened_x = flatten_list(x)
print(flattened_x)
# ---------- end python_3_script_2 ----------
partition_list = PartitionList(List=python_3_script_2, Size=python_3_script.MapSize)
construct_point = ConstructPoint(XCoordinate=series, YCoordinate=graft(series), ZCoordinate=partition_list)  # -> flatten(Point)
deconstruct = Deconstruct(Point=construct_point)  # -> XComponent, YComponent, ZComponent
bounds = Bounds(Numbers=deconstruct.ZComponent)
remap_numbers = RemapNumbers(Value=deconstruct.ZComponent, Source=bounds, Target=construct_domain)  # -> Mapped, Clipped
gradient = Gradient(
    LowerLimit=deconstruct_domain.End,
    UpperLimit=deconstruct_domain.Start,
    Parameter=remap_numbers.Mapped,
    stops=[0: RGB(234, 38, 0), 0.25: RGB(234, 126, 0), 0.5: RGB(254, 244, 84), 0.75: RGB(173, 203, 249), 1: RGB(75, 107, 169)])
construct_point_2 = ConstructPoint(XCoordinate=deconstruct.XComponent, YCoordinate=deconstruct.YComponent, ZCoordinate=remap_numbers.Mapped)
panel = Panel(python_3_script_2)
integer_2 = Integer(python_3_script.MapSize)
python_3_script_3 = Python3Script(grid_size=integer_2)  # -> out, A_points, B_points, C_points, D_points
# ---------- python_3_script_3: Python ----------
def generate_faces_and_categorize(grid_size):
    # 网格的尺寸
    grid_size = grid_size
    total_points = grid_size * grid_size  # 64x64网格，共4096个点

    # 存储每个角点的序号
    A_points = []
    B_points = []
    C_points = []
    D_points = []

    # 遍历每个小块网格
    for i in range(grid_size - 1):  # 64x64的网格总共有63个小块
        for j in range(grid_size - 1):
            # 计算当前小块的四个角点的序号，按逆时针顺序
            A = i * grid_size + j          # 左上角点
            B = i * grid_size + (j + 1)    # 右上角点
            C = (i + 1) * grid_size + (j + 1)  # 右下角点
            D = (i + 1) * grid_size + j    # 左下角点

            # 将各角点序号分别添加到不同的列表
            A_points.append(A)
            B_points.append(B)
            C_points.append(C)
            D_points.append(D)

    # 输出四个角点的分类列表
    return A_points, B_points, C_points, D_points


# 获取每个角点的序号列表
A_points, B_points, C_points, D_points = generate_faces_and_categorize(grid_size)

# 打印示例
print("A points:", A_points[:10])  # 仅打印前10个A点的序号
print("B points:", B_points[:10])  # 仅打印前10个B点的序号
print("C points:", C_points[:10])  # 仅打印前10个C点的序号
print("D points:", D_points[:10])  # 仅打印前10个D点的序号
# ---------- end python_3_script_3 ----------
surface_from_points = SurfaceFromPoints(Points=construct_point_2, UCount=python_3_script.MapSize, Interpolate=False)
mesh_quad = MeshQuad(
    CornerA=python_3_script_3.A_points,
    CornerB=python_3_script_3.B_points,
    CornerC=python_3_script_3.C_points,
    CornerD=python_3_script_3.D_points)
construct_mesh = ConstructMesh(Vertices=construct_point_2, Faces=mesh_quad, Colours=gradient)

python_3_script_4 = Python3Script(trajectories_dict=python_3_script.Trajectories)  # -> out, agent_0_trajectory, agent_1_trajectory, agent_2_trajectory; inputs trajectories_dict: list
# ---------- python_3_script_4: Python ----------
def flatten_trajectories(trajectories_list):
    """
    输入：包含智能体路径的嵌套列表，每个元素是一个智能体的路径列表。
    输出：三个展平后的列表，分别代表三个智能体的路径。
    """
    flattened_trajectories = []

    # 遍历每个智能体的路径
    for trajectory in trajectories_list:
        # 展平每个路径的坐标
        flattened_trajectories.append([coord for point in trajectory for coord in point])
    
    return flattened_trajectories




# 调用函数
flattened_trajectories = flatten_trajectories(trajectories_dict)

agent_0_trajectory = flattened_trajectories[0]
agent_1_trajectory = flattened_trajectories[1]
agent_2_trajectory = flattened_trajectories[2]
# ---------- end python_3_script_4 ----------

list_item = ListItem(List=python_3_script.StartPoint, Index=0, Wrap=True)  # -> Item, Item1
construct_point_3 = ConstructPoint(XCoordinate=list_item.Item, YCoordinate=list_item.Item1, ZCoordinate=0)

list_item_2 = ListItem(List=python_3_script.EndPoint, Index=0, Wrap=True)  # -> Item, Item1
construct_point_4 = ConstructPoint(XCoordinate=list_item_2.Item, YCoordinate=list_item_2.Item1, ZCoordinate=0)

panel_2 = Panel(python_3_script.Episode)
panel_3 = Panel(python_3_script.MapSize)

partition_list_2 = PartitionList(List=python_3_script_4.agent_2_trajectory, Size=2)
partition_list_3 = PartitionList(List=python_3_script_4.agent_1_trajectory, Size=2)
partition_list_4 = PartitionList(List=python_3_script_4.agent_0_trajectory, Size=2)
list_item_3 = ListItem(List=partition_list_2, Index=0, Wrap=True)  # -> Item, Item1
list_item_4 = ListItem(List=partition_list_3, Index=0, Wrap=True)  # -> Item, Item1
list_item_5 = ListItem(List=partition_list_4, Index=0, Wrap=True)  # -> Item, Item1
construct_point_5 = ConstructPoint(XCoordinate=list_item_3.Item, YCoordinate=list_item_3.Item1, ZCoordinate=0)  # -> flatten(Point)
construct_point_6 = ConstructPoint(XCoordinate=list_item_4.Item, YCoordinate=list_item_4.Item1, ZCoordinate=0)  # -> flatten(Point)
construct_point_7 = ConstructPoint(XCoordinate=list_item_5.Item, YCoordinate=list_item_5.Item1, ZCoordinate=0)  # -> flatten(Point)
insert_items = InsertItems(List=construct_point_5, Item=construct_point_3, Indices=0, Wrap=True)
insert_items_2 = InsertItems(List=construct_point_6, Item=construct_point_3, Indices=0, Wrap=True)
insert_items_3 = InsertItems(List=construct_point_7, Item=construct_point_3, Indices=0, Wrap=True)
insert_items_4 = InsertItems(List=insert_items, Item=construct_point_4, Indices=-1, Wrap=True)
insert_items_5 = InsertItems(List=insert_items_2, Item=construct_point_4, Indices=-1, Wrap=True)
interpolate = Interpolate(Vertices=insert_items_4, Degree=3, Periodic=False, KnotStyle=1)  # -> Curve, Length, Domain
interpolate_2 = Interpolate(Vertices=insert_items_5, Degree=3, Periodic=False, KnotStyle=1)  # -> Curve, Length, Domain
insert_items_6 = InsertItems(List=insert_items_3, Item=construct_point_4, Indices=-1, Wrap=True)
interpolate_3 = Interpolate(Vertices=insert_items_6, Degree=3, Periodic=False, KnotStyle=1)  # -> Curve, Length, Domain
number_slider = Slider(6, range=0..10)
rebuild_curve = RebuildCurve(Curve=interpolate.Curve, Count=number_slider, Tangents=False)
rebuild_curve_2 = RebuildCurve(Curve=interpolate_3.Curve, Count=number_slider, Tangents=False)
rebuild_curve_3 = RebuildCurve(Curve=interpolate_2.Curve, Count=number_slider, Tangents=False)
merge = Merge(Data1=rebuild_curve_2, Data2=rebuild_curve_3, Data3=rebuild_curve)
number_slider_2 = Slider(0.5, range=0..1)
negative = Negative(Value=number_slider_2)
offset_curve = OffsetCurve(Curve=merge, Distance=number_slider_2, Corners=1)
offset_curve_2 = OffsetCurve(Curve=merge, Distance=negative, Corners=1)
end_points = EndPoints(Curve=offset_curve)  # -> Start, End
end_points_2 = EndPoints(Curve=offset_curve_2)  # -> Start, End
line = Line(StartPoint=end_points.End, EndPoint=end_points_2.End)
line_2 = Line(StartPoint=end_points.Start, EndPoint=end_points_2.Start)
join_curves = JoinCurves(Curves=[offset_curve, line_2, offset_curve_2, line], Preserve=False)  # -> simplify(flatten(Curves))
region_union = RegionUnion(Curves=join_curves)
project = Project(Curve=region_union, Brep=surface_from_points, Direction=Vector(0, 0, 1))  # -> flatten(Curve)
surface_split = SurfaceSplit(Surface=surface_from_points, Curves=project)
list_item_6 = ListItem(List=surface_split, Index=-1, Wrap=True)
unit_z = UnitZ(Factor=Slider(0.1, range=0..1))
extrude = Extrude(Base=list_item_6, Direction=unit_z)
mesh_brep = MeshBrep(
    Brep=extrude,
    Settings={GridMaxCount=0, GridMinCount=16, JaggedSeams=False, MaxEdgeLength=0, MinEdgeLength=0.0001, MinTolerance=0, Refine=True, RefineAngle=0, RelativeTolerance=0.65, SimplePlanes=True, Tolerance=0})

python_3_script_5 = Python3Script(x=python_3_script.BoundaryVertices)  # -> flattened_x; inputs x: list; same code as python_3_script_2
partition_list_5 = PartitionList(List=python_3_script_5, Size=2)
list_item_7 = ListItem(List=partition_list_5, Index=0, Wrap=True)  # -> Item, Item1
panel_4 = Panel(python_3_script_5)
construct_point_8 = ConstructPoint(XCoordinate=list_item_7.Item, YCoordinate=list_item_7.Item1, ZCoordinate=0)  # -> flatten(Point)
polyline = PolyLine(Vertices=construct_point_8, Closed=True)

python_3_script_6 = Python3Script(x=python_3_script.Structures)  # -> flattened_x; inputs x: list; same code as python_3_script_2
partition_list_6 = PartitionList(List=python_3_script_6, Size=2)
list_item_8 = ListItem(List=partition_list_6, Index=0, Wrap=True)  # -> Item, Item1
construct_point_9 = ConstructPoint(XCoordinate=list_item_8.Item, YCoordinate=list_item_8.Item1, ZCoordinate=0)  # -> flatten(Point)
panel_5 = Panel(python_3_script_6)

python_3_script_7 = Python3Script(x=python_3_script.Trees)  # -> flattened_x; inputs x: list; same code as python_3_script_2
partition_list_7 = PartitionList(List=python_3_script_7, Size=2)
list_item_9 = ListItem(List=partition_list_7, Index=0, Wrap=True)  # -> Item, Item1
panel_6 = Panel(python_3_script_7)
construct_point_10 = ConstructPoint(XCoordinate=list_item_9.Item, YCoordinate=list_item_9.Item1, ZCoordinate=0)  # -> flatten(Point)

python_3_script_8 = Python3Script(x=python_3_script.Landscapes)  # -> flattened_x; inputs x: list; same code as python_3_script_2
partition_list_8 = PartitionList(List=python_3_script_8, Size=2)
list_item_10 = ListItem(List=partition_list_8, Index=0, Wrap=True)  # -> Item, Item1
construct_point_11 = ConstructPoint(XCoordinate=list_item_10.Item, YCoordinate=list_item_10.Item1, ZCoordinate=0)  # -> flatten(Point)
panel_7 = Panel(python_3_script_8)

deconstruct_brep = DeconstructBrep(Brep=surface_from_points)  # -> Faces, Edges, Vertices
negative_2 = Negative(Value=Slider(3, range=0..10))
construct_point_12 = ConstructPoint(XCoordinate=0, YCoordinate=0, ZCoordinate=negative_2)
join_curves_2 = JoinCurves(Curves=deconstruct_brep.Edges, Preserve=False)
xy_plane = XYPlane(Origin=construct_point_12)
project_2 = Project(Geometry=join_curves_2, Plane=xy_plane)  # -> Geometry, Transform
boundary_surfaces = BoundarySurfaces(Edges=project_2.Geometry)
loft = Loft(
    Curves=[join_curves_2, project_2.Geometry],
    Options={Adjust=False, Closed=False, LoftEnds=0, LoftSimp=0, LoftType=0, Rebuild=10, Refit=0.01})
brep_join = BrepJoin(Breps=[boundary_surfaces, loft])  # -> Breps, Closed
mesh_brep_2 = MeshBrep(
    Brep=brep_join.Breps,
    Settings={GridMaxCount=0, GridMinCount=16, JaggedSeams=False, MaxEdgeLength=0, MinEdgeLength=0.0001, MinTolerance=0, Refine=True, RefineAngle=0, RelativeTolerance=0.65, SimplePlanes=True, Tolerance=0})

project_3 = Project(Curve=polyline, Brep=surface_from_points, Direction=Vector(0, 0, 1))  # -> flatten(Curve)
unit_z_2 = UnitZ(Factor=Slider(0.2, range=0..1))
move = Move(Geometry=project_3, Motion=unit_z_2)  # -> Geometry, Transform
custom_preview_lineweights = CustomPreviewLineweights(
    Geometry=move.Geometry,
    Shader=ColourSwatch(SwatchColor=RGB(255, 0, 0)),
    Thickness=Slider(3.8, range=0..10),
    Absolute=False)

merge_2 = Merge(Data1=construct_point_9, Data2=construct_point_11)
unit_z_3 = UnitZ(Factor=10)
unit_z_4 = UnitZ(Factor=1)
project_point = ProjectPoint(Point=merge_2, Direction=unit_z_3)  # -> Point, Index; disabled
project_point_2 = ProjectPoint(Point=construct_point_10, Direction=unit_z_4, Geometry=surface_from_points)  # -> Point, Index
line_sdl = LineSDL(Start=merge_2, Direction=unit_z_3, Length=100)
surface_line = SurfaceLine(Surface=surface_from_points, Line=line_sdl, LimitToFirst=False)  # -> Curves, flatten(Points), UVPoints, Normal

construct_domain_2 = ConstructDomain(DomainStart=Slider(0.6, range=0..1), DomainEnd=Slider(1, range=0..10))
construct_domain_3 = ConstructDomain(DomainStart=0, DomainEnd=Slider(180, range=0..1000))
xy_plane_2 = XYPlane(Origin=project_point_2.Point)
boolean_toggle = BooleanToggle(True)
button = Button()
guid = Guid([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])
list_length = ListLength(List=project_point_2.Point)
addgeometrys = AddGeometrys(
    Run=Toggle(True),
    GeometryGuid=flatten(guid),
    GeometryLocation=flatten(project_point_2.Point),
    ScaleDomain=construct_domain_2,
    RotateDomain=construct_domain_3,
    GeometryPlane=flatten(xy_plane_2),
    Seed=Slider(53, range=0..100),
    Accurate=True,
    Group=True)
guid_2 = Guid(flatten(addgeometrys))
delete_guid = DeleteGuid(Guids=addgeometrys)
deleteonlayer = DeleteOnLayer(Run=False, Layer="图层04", enableFullPath=False)
negative_3 = Negative(Value=list_length)
data_recorder = DataRecorder(guid_2, DataLimit=-10, RecordData=True)
reverse_list = ReverseList(List=data_recorder)
list_length_2 = ListLength(List=reverse_list)  # -> expr("x-1", Length)
construct_domain_4 = ConstructDomain(DomainStart=list_length, DomainEnd=list_length_2)
sub_list = SubList(List=reverse_list, Domain=construct_domain_4, Wrap=True)  # -> List, Index
python_3_script_9 = Python3Script(guids_to_delete=sub_list.List)  # -> out, a; inputs guids_to_delete: list
# ---------- python_3_script_9: Python ----------
import rhinoscriptsyntax as rs
import scriptcontext
import Rhino

def delete_objects_by_guids(guids):
    """
    根据给定的 GUID 列表删除对应的 Rhino 物体
    参数:
        guids: 包含 GUID 字符串的列表
    """
    # 确保输入是一个有效的 GUID 列表
    if not isinstance(guids, list):
        print("请提供有效的 GUID 列表")
        return
    
    # 切换到 Rhino 环境以执行删除操作
    scriptcontext.doc = Rhino.RhinoDoc.ActiveDoc

    for guid in guids:
        # 检查 GUID 是否有效
        if rs.IsObject(guid):
            # 删除该物体
            rs.DeleteObject(guid)
            print(f"已删除物体，GUID: {guid}")
        else:
            print(f"无效的 GUID: {guid}")

# 示例：假设 guids 是一个包含多个 Rhino 物体 GUID 的列表
guids_to_delete1 = [
    "f9b508b7-635f-49f6-9ffb-e2b013672ba3",  # 示例 GUID
    "6b0d80b3-d0a0-4316-babb-8e2f13d0d0ac",  # 示例 GUID
    "d845fa38-3f89-4dff-bb8b-7e8b0c1f4c6e"   # 示例 GUID
]

# 删除指定的物体
delete_objects_by_guids(guids_to_delete)
# ---------- end python_3_script_9 ----------

unit_z_5 = UnitZ(Factor=-10)  # disabled
move_2 = Move(Geometry=polyline, Motion=unit_z_5)  # -> Geometry, Transform; disabled
unit_z_6 = UnitZ(Factor=100)  # disabled
extrude_2 = Extrude(Base=move_2.Geometry, Direction=unit_z_6)  # disabled
cap_holes = CapHoles(Brep=extrude_2)  # disabled
mesh_brep_3 = MeshBrep(
    Brep=cap_holes,
    Settings={GridMaxCount=0, GridMinCount=16, JaggedSeams=False, MaxEdgeLength=0, MinEdgeLength=0.0001, MinTolerance=0, Refine=True, RefineAngle=0, RelativeTolerance=0.65, SimplePlanes=True, Tolerance=0})  # disabled
mesh_split = MeshSplit(Mesh=construct_mesh, Splitters=mesh_brep_3)  # disabled
list_item_11 = ListItem(List=mesh_split, Index=0, Wrap=True)  # -> Item, Item1; disabled
mesh = Mesh(list_item_11.Item1)  # disabled
mesh_2 = Mesh(list_item_11.Item)  # disabled

python_3_script_10 = Python3Script(x=surface_line.Points)  # -> out, a; inputs x: list
# ---------- python_3_script_10: Python ----------
a =[]
if x:
    a.append(True)
    a.append(True)
# ---------- end python_3_script_10 ----------

construct_domain_5 = ConstructDomain(DomainStart=Slider(1, range=0..1), DomainEnd=Slider(1.5, range=0..10))
construct_domain_6 = ConstructDomain(DomainStart=0, DomainEnd=Slider(180, range=0..1000))
xy_plane_3 = XYPlane(Origin=surface_line.Points)
boolean_toggle_2 = BooleanToggle(True)
boolean_toggle_3 = BooleanToggle(True)
button_2 = Button()
guid_3 = Guid([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])
list_length_3 = ListLength(List=surface_line.Points)
addgeometrys_2 = AddGeometrys(
    Run=python_3_script_10.a,
    GeometryGuid=flatten(guid_3),
    GeometryLocation=flatten(surface_line.Points),
    ScaleDomain=construct_domain_5,
    RotateDomain=construct_domain_6,
    GeometryPlane=flatten(xy_plane_3),
    Seed=Slider(53, range=0..100),
    Accurate=True,
    Group=True)
guid_4 = Guid(flatten(addgeometrys_2))
negative_4 = Negative(Value=list_length_3)
delete_guid_2 = DeleteGuid(Guids=addgeometrys_2)
deleteonlayer_2 = DeleteOnLayer(Run=False, Layer="图层04", enableFullPath=False)
data_recorder_2 = DataRecorder(guid_4, DataLimit=-10, RecordData=True)
reverse_list_2 = ReverseList(List=data_recorder_2)
list_length_4 = ListLength(List=reverse_list_2)  # -> expr("x-1", Length)
construct_domain_7 = ConstructDomain(DomainStart=list_length_3, DomainEnd=list_length_4)
sub_list_2 = SubList(List=reverse_list_2, Domain=construct_domain_7, Wrap=True)  # -> List, Index
python_3_script_11 = Python3Script(guids_to_delete=sub_list_2.List)  # -> out, a; inputs guids_to_delete: list; same code as python_3_script_9

panel_8 = Panel("鹅卵石03，杂色")
panel_9 = Panel("橡胶沥青 03")
panel_10 = Panel("Stone grass")
createattributes = CreateAttributes(MaterialName="Stone gravel", enableFullPath=False)
boolean_toggle_4 = BooleanToggle(True)
bake_geometry = BakeGeometry(Bake=boolean_toggle_4, Geometry=mesh_brep, Attributes=createattributes, DeleteOldBakes=True, PreserveTrees=False)

pipe = Pipe(Curve=move.Geometry, Radius=0.05, Caps=0)
createattributes_2 = CreateAttributes(MaterialName="红线", enableFullPath=False)
bake_geometry_2 = BakeGeometry(Bake=boolean_toggle_4, Geometry=pipe, Attributes=createattributes_2, DeleteOldBakes=True, PreserveTrees=False)

createattributes_3 = CreateAttributes(MaterialName="草 01", enableFullPath=False)
bake_geometry_3 = BakeGeometry(Bake=boolean_toggle_4, Geometry=construct_mesh, Attributes=createattributes_3, DeleteOldBakes=True, PreserveTrees=False)

panel_11 = Panel("草 04")

createattributes_4 = CreateAttributes(MaterialName="土面 02", enableFullPath=False)
bake_geometry_4 = BakeGeometry(Bake=Toggle(True), Geometry=mesh_brep_2, Attributes=createattributes_4, DeleteOldBakes=True, PreserveTrees=False)
